# Dynamo graph 170913 dynamo convert ifc files.dyn (Dynamo 1.3.1.1736)

file_path = Filename("..\ifc\grasshopper\revit\170816 demo column.ifc")
string = StringInput("C:\My Work\Geometry Gym\Documents\GeometryGym\BIM\ifc\grasshopper\revit\170817 demo.rvt")
convertFile = ggDynamoIFC.ggDynamoIFC.ConvertFile(file_path, string)
watch = Watch(convertFile.out1)
watch_2 = Watch(convertFile.out0)
