# Dynamo graph Quadrosphere.Claddings v4.dyn (Dynamo 2.10.1.3976)
# packages: Structural Analysis for Dynamo 2.11.0

cladding_type = StringInput("One-way X")
cladding_type_2 = StringInput("One-way Y")
select_model_elements = DSModelElementsSelection()  # 173 picked in the model
string = StringInput("Structural Connections")
run = BoolSelector(false)
apply_wind_load_by_panel_example = Python(IN[4]=run)  # IronPython2; unwired: IN[0], IN[1], IN[2], IN[3]
# ---------- apply_wind_load_by_panel_example.python (54 lines) ----------
if IN[4]:
	import clr
	clr.AddReference('ProtoGeometry')
	from Autodesk.DesignScript.Geometry import *
	
	from System import Environment
	user = Environment.GetFolderPath(Environment.SpecialFolder.ApplicationData)
	clr.AddReferenceToFileAndPath(IN[3])
	from RobotOM import *
	from System import Object
	
	
	
	surfaces = IN[0]
	fz = 1000*IN[1] #to Pa
	load_name = IN[2]
	
	
	application = RobotApplicationClass()
	project = application.Project
	structure = project.Structure
	labels = structure.Labels
	loads = []



	####create Self Weight for beams
	structure.Cases.Delete(1)
	case = structure.Cases.CreateSimple(1,"Self Weight", IRobotCaseNature.I_CN_PERMANENT, IRobotCaseAnalizeType.I_CAT_STATIC_LINEAR)
	###end self weight



	load_case = 2 #any suitable number, I guess 1 is for DL
	m = structure.Cases.Delete(load_case) #delete the case to avoid doubling
	#create case
	case_rob_type = IRobotCaseNature.I_CN_WIND
	case = structure.Cases.CreateSimple(load_case,load_name, case_rob_type, IRobotCaseAnalizeType.I_CAT_STATIC_LINEAR)
	
	
	loads =[]
	for i in range(len(surfaces)):
		#create load
		load_nmb = case.Records.New(IRobotLoadRecordType.I_LRT_UNIFORM)
		load = structure.Cases.Get(load_case).Records.Get(load_nmb)
		load.SetValue(IRobotUniformRecordValues.I_URV_LOCAL_SYSTEM,1) #1 means True
		load.SetValue(IRobotUniformRecordValues.I_URV_PZ,fz[i])
		loads.append(load)
		#apply load
		load.Objects.FromText(surfaces[i].Number)
	
	OUT = "done"

OUT = "switch Run is OFF"
# ----------------------------------------
run_2 = BoolSelector(false)
apply_wind_load_3_point_example = Python(IN[4]=run_2)  # IronPython2; unwired: IN[0], IN[1], IN[2], IN[3], IN[5]
# ---------- apply_wind_load_3_point_example.python (62 lines) ----------
if IN[4]:
	import clr
	clr.AddReference('ProtoGeometry')
	from Autodesk.DesignScript.Geometry import *
	
	from System import Environment
	user = Environment.GetFolderPath(Environment.SpecialFolder.ApplicationData)
	clr.AddReferenceToFileAndPath(IN[3])
	from RobotOM import *
	from System import Object
	
	surfaces = IN[0]
	fz = 1000*IN[1] #to Pa
	load_name = IN[2]
	pts = IN[5]
	
	
	application = RobotApplicationClass()
	project = application.Project
	structure = project.Structure
	labels = structure.Labels
	loads = []



	####create Self Weight for beams
	structure.Cases.Delete(1)
	case = structure.Cases.CreateSimple(1,"Self Weight", IRobotCaseNature.I_CN_PERMANENT, IRobotCaseAnalizeType.I_CAT_STATIC_LINEAR)
	###end self weight
		
	load_case = 2 #if no numbers befor exist - it will fail
	m = structure.Cases.Delete(load_case) #delete the case to avoid doubling
	#create case
	case_rob_type = IRobotCaseNature.I_CN_WIND
	case = structure.Cases.CreateSimple(load_case,load_name, case_rob_type, IRobotCaseAnalizeType.I_CAT_STATIC_LINEAR)
		
		
	loads =[]
	
	#create load
	load_nmb = case.Records.New(IRobotLoadRecordType.I_LRT_IN_3_POINTS)
	load = structure.Cases.Get(load_case).Records.Get(load_nmb)

	load.SetPoint(1,4.67, -5.00, 0.00)
	load.SetPoint(2,2.40, -5.00, 2.67)
	load.SetPoint(3,4.67, -2.72, 2.67)

	load.SetValue(IRobotIn3PointsRecordValues.I_3PRV_LOCAL_SYSTEM,1) #1 means True
	load.SetValue(IRobotIn3PointsRecordValues.I_3PRV_PZ1,1000)#fz[i])
	load.SetValue(IRobotIn3PointsRecordValues.I_3PRV_PZ2,2000)
	load.SetValue(IRobotIn3PointsRecordValues.I_3PRV_PZ3,3000)	

	loads.append(load)
	#apply load
	load.Objects.FromText(surfaces[0].Number)




	OUT = "done"

OUT = "switch Run is OFF"
# ----------------------------------------

# group: Wind load
wind_speed = CodeBlock { 45; }
load_in_kpa = CodeBlock(x=wind_speed) { 0.5*1.2*x*x/1000; }

watch = Watch(load_in_kpa)
string_2 = StringInput("Generic Models")
byName = Category.ByName(name=string_2)
all_elements_of_category = ElementsOfCategory(Category=byName)
filter_adaptive_only = Python(IN[0]=all_elements_of_category)  # IronPython2
# ---------- filter_adaptive_only.python (13 lines) ----------
#import sys
#import clr
#clr.AddReference('ProtoGeometry')
#from Autodesk.DesignScript.Geometry import *

p = IN[0]
m = []

for i in p:
	if str(i.GetType()) == "Revit.Elements.AdaptiveComponent":
		m.append(i)

OUT = m
# ----------------------------------------
code_block = CodeBlock { "membrane"; }
filter = Python(IN[0]=filter_adaptive_only, IN[1]=code_block)  # IronPython2
# ---------- filter.python (8 lines) ----------
ss = IN[0]
gg = []
for i in ss:
	 if IN[1] in str(i):
	 	gg.append(i)

	 	
OUT = gg
# ----------------------------------------
locations = AdaptiveComponent.Locations(adaptiveComponent=filter)
watch_2 = Watch(locations)
to_meters_filter = Python(IN[0]=watch_2)  # IronPython2
# ---------- to_meters_filter.python (48 lines) ----------
import clr
clr.AddReference('ProtoGeometry')
from Autodesk.DesignScript.Geometry import *



p = IN[0]
outp = []

p1 = []
p2 = []
p3 = []

if isinstance(p[0], list):
	cp = "list of elements"
	for i in p:
		gg = []
		for j in i:

			xxx = j.X
			yyy = j.Y
			zzz = j.Z			
			
			if -0.001<j.X<0.001: #in meters!
				xxx = 0
			if -0.001<j.Y<0.001:
				yyy = 0	
			if -0.001<j.Z<0.001:
				zzz = 0					

				
			gg.append(Point.ByCoordinates(xxx/1000,yyy/1000,zzz/1000))
			
		outp.append(gg)
	p1.append(outp)	
	p1 = p1[0]
		
		
	
		
else: 
	cp = "one element"
	for j in p:
		outp.append(Point.ByCoordinates(j.X/1000,j.Y/1000,j.Z/1000))
	p1 = outp		

	
OUT = p1
# ----------------------------------------
fix_fckn_center_for_spheres = Python(IN[0]=to_meters_filter)  # IronPython2
# ---------- fix_fckn_center_for_spheres.python (39 lines) ----------
import clr
clr.AddReference('ProtoGeometry')
from Autodesk.DesignScript.Geometry import *


pt = IN[0]

p1=[]
for sublist in pt:
    for item in sublist:
        p1.append(item)

allZ = []

for i in range(len(p1)):
	allZ.append(p1[i].Z)
	
maxZ = max(allZ)

for i in pt:
	for j in i:
		if j.Z==maxZ:
			xx = j.X
			yy = j.Y


#for i in range(len(p1)):
#	p1f.append(Point.ByCoordinates(p1[i].X-xx,p1[i].Y-yy,p1[i].Z))
#	p2f.append(Point.ByCoordinates(p2[i].X-xx,p2[i].Y-yy,p2[i].Z))
outp = []
for i in pt:
	gg = []
	for j in i:
		gg.append(Point.ByCoordinates(j.X-xx,j.Y-yy,j.Z))
	outp.append(gg)



OUT = outp
# ----------------------------------------
relative_points_h = Python(IN[0]=fix_fckn_center_for_spheres)  # IronPython2
# ---------- relative_points_h.python (31 lines) ----------
p = IN[0]
ph = []

zmax = []
outp = []

if isinstance(p[0], list):
	for i in p:
		for j in i:								
			zmax.append(j.Z)			
zmax = max(zmax)
	

if isinstance(p[0], list):
	for i in p:
		gg = []
		for j in i:		
			gg.append(round(j.Z*1000/zmax)/1000)		
		outp.append(gg)
	ph.append(outp)	
	ph = ph[0]

		
				
else: 
	for j in p:
		outp.append(round(j.Z*1000/zmax)/1000)
	ph = outp		

	
OUT = ph
# ----------------------------------------

# group: counter-clockwise from ---->x axis
wind_dir_manual_correction = CodeBlock { 45; }

angle_as_180_deg = Python(IN[0]=fix_fckn_center_for_spheres, IN[1]=wind_dir_manual_correction)  # IronPython2
# ---------- angle_as_180_deg.python (43 lines) ----------
import math 

p = IN[0]
manual = IN[1]
ph = []

zmax = []
outp = []

if isinstance(p[0], list):
	for i in p:
		for j in i:								
			zmax.append(j.Z)			
zmax = max(zmax)
		

if isinstance(p[0], list):
	for i in p:
		gg = []
		for j in i:
			if j.X<0:
				if j.Y>0:			
					degr = math.degrees(math.atan((j.Y+0.001)/(j.X+0.001)))+180+manual
					#0.001 to avoid "divide by zero" error
				else:
					degr = math.degrees(math.atan((j.Y+0.001)/(j.X+0.001)))-180+manual
			else:
				degr = math.degrees(math.atan((j.Y+0.001)/(j.X+0.001)))+manual			
		
			gg.append(round(degr))			
		outp.append(gg)
	ph.append(outp)	
	ph = ph[0]

		
				
else: 
	for j in p:
		outp.append(round(math.degrees(math.atan((j.Y+0.001)/(j.X+0.001)))))
	ph = outp		

	
OUT = ph
# ----------------------------------------

# group: surface pressure coefficient Cp
k_h_d_see_pdf = CodeBlock { 0.5; }
k_0_1 = CodeBlock { [-0.78,-0.49,0.57,-0.085,-0.34,0.07]; }
k_0_2 = CodeBlock { [-0.15,-0.9,1.2,0.043,-0.9,0.16]; }
k_0_3 = CodeBlock { [-1.53,0.05,1.45,-0.49,-0.55,0.12]; }
k_0_4 = CodeBlock { [-1.02,-0.68,1.86,-0.38,-0.54,0.032]; }
k_0_5 = CodeBlock { [-2.31,0.2,2.15,-1.21,0.23,-0.147]; }
k_0_6 = CodeBlock { [-2.8,0.81,2.08,-2,1.08,-0.39]; }
k_0_7 = CodeBlock { [-1.11,-0.82,2.6,-1.27,0.52,-0.3]; }
coefficients = Python(IN[0]=k_h_d_see_pdf, IN[1]=k_0_1, IN[2]=k_0_2, IN[3]=k_0_3, IN[4]=k_0_4, IN[5]=k_0_5, IN[6]=k_0_6, IN[7]=k_0_7, IN[8]=relative_points_h, IN[9]=angle_as_180_deg)  # IronPython2
# ---------- coefficients.python (48 lines) ----------
from math import *

k = IN[0]
#IN 1-6 called from row 9
h = IN[8]
angle = IN[9]

ss =str(k).split(".")[1] #get the correct k01_k05
s = IN[int(ss)] #it works! ahahaha

Region1 = []
Region2 = []
RegionTotal = []

for j in range(len(h)):
	r1 = []
	r2 = []
	fi = []
	for i in range(3):
	#checked, see excel
		r1.append((s[0]*h[j][i]*h[j][i]+s[1]*h[j][i]+s[2])*cos(2*radians(angle[j][i]))/2 + (s[3]*h[j][i]*h[j][i]+s[4]*h[j][i]+s[5])) 
	
	
		if h[i]>0.7: fi.append(3.142) #180 deg in rad
		else: fi.append(-136.2*k+22.14*h[j][i]+94.95*k*k+31.54*k*h[j][i]+179.1)
	
	#not checked
		r2.append((s[0]*h[j][i]*h[j][i]+s[1]*h[j][i]+s[2])*cos(2*fi[i])/2 + (s[3]*h[j][i]*h[j][i]+s[4]*h[j][i]+s[5])) 

	Region1.append(r1)
	Region2.append(r2)


#simplified case for k = 0.5 only and Region 2
# same area with surface between h<=0.7 and -140 < angle < 140
# btw for k = 0.4 ---> h<=0.7 and -148 < angle < 148

for j in range(len(h)):
	rt = []
	for i in range(3):
		if (h[j][i]<=0.7) and (-140>angle[j][i] or angle[j][i]>140):
			rt.append(Region2[j][i])
		else: 
			rt.append(Region1[j][i])
	RegionTotal.append(rt)
				
#OUT = Region1, Region2, RegionTotal
OUT = RegionTotal
# ----------------------------------------
region1_region2 = Watch(coefficients)

pressure_by_point_in_kpa = Python(IN[0]=watch, IN[1]=region1_region2)  # IronPython2
# ---------- pressure_by_point_in_kpa.python (10 lines) ----------
pr = []
pa = IN[0]
cc = IN[1]
for j in range(len(cc)):
	x = []
	for i in range(3):	
		x.append(cc[j][i]*pa*(-1)) # -1 to invert local axis
	pr.append(x)
		
OUT = pr
# ----------------------------------------
flatten = List.Flatten(list=pressure_by_point_in_kpa)
maximumItem = List.MaximumItem(list=flatten)
watch_3 = Watch(maximumItem)
minimumItem = List.MinimumItem(list=flatten)
watch_4 = Watch(minimumItem)
flatten_2 = List.Flatten(list=region1_region2)
maximumItem_2 = List.MaximumItem(list=flatten_2)
watch_5 = Watch(maximumItem_2)
minimumItem_2 = List.MinimumItem(list=flatten_2)
watch_6 = Watch(minimumItem_2)
robot_library_address_change = StringInput("C:\Users\64210\AppData\Roaming\Dynamo\Dynamo Core\2.6\packages\Structural Analysis for Dynamo\bin\RSA\Interop.RobotOM.dll")  # "Robot library address, change version"
cladding_type_3 = StringInput("Two-way")
run_3 = BoolSelector(true)
create_cladding_from_3_points = Python(IN[0]=fix_fckn_center_for_spheres, IN[1]=robot_library_address_change, IN[2]=cladding_type_3, IN[4]=run_3)  # IronPython2; unwired: IN[3]
# ---------- create_cladding_from_3_points.python (59 lines) ----------
import clr
clr.AddReference('ProtoGeometry')
from Autodesk.DesignScript.Geometry import *
from System import Environment
user = Environment.GetFolderPath(Environment.SpecialFolder.ApplicationData)
clr.AddReferenceToFileAndPath(IN[1])#or r"C:\Users\64210\AppData\Roaming\Dynamo\Dynamo Core\2.6\packages\Structural Analysis for Dynamo\bin\RSA\Interop.RobotOM.dll"
from RobotOM import *
from System import Object
#from math import *
#from itertools import compress

#vars for robot
app = RobotApplicationClass()
project = app.Project
structure = project.Structure
labels = structure.Labels
loads = structure.Cases
ProjectPrefs = project.Preferences
#bars = structure.Bars
objects = structure.Objects
nodes = structure.Nodes


input2 = IN[0]
clad_typename = IN[2]
restart = IN[3]

def program3(input):	
	fn = objects.FreeNumber# use number if you want to restart the model <-- never use this 
	p1 = input[0]
	p2 = input[1]
	p3 = input[2]
		
	points = app.CmpntFactory.Create(IRobotComponentType.I_CT_POINTS_ARRAY)
	points.SetSize(3)
	points.Set(1,p1.X,p1.Y,p1.Z)
	points.Set(2,p2.X,p2.Y,p2.Z)
	points.Set(3,p3.X,p3.Y,p3.Z)
		
	objects.CreateContour(fn, points)
	ro = objects.Get(fn)
		
	ro.Initialize()
	ro.SetLabel(IRobotLabelType.I_LT_CLADDING, clad_typename)
	ro.Update()
	
	return UnwrapElement(ro)
	

a = []
z = []
if IN[4]:
	for i in range(len(input2)):
		a = program3(input2[i])
		z.append(a)
    
result = z
 
OUT = result
# ----------------------------------------
load_name = CodeBlock { "WindDynamo"; }
run_4 = BoolSelector(true)
apply_wind_load_3_point = Python(IN[0]=create_cladding_from_3_points, IN[1]=pressure_by_point_in_kpa, IN[2]=load_name, IN[3]=robot_library_address_change, IN[4]=run_4, IN[5]=fix_fckn_center_for_spheres)  # IronPython2
# ---------- apply_wind_load_3_point.python (70 lines) ----------
if IN[4]:

	import clr
	clr.AddReference('ProtoGeometry')
	from Autodesk.DesignScript.Geometry import *
	
	from System import Environment
	user = Environment.GetFolderPath(Environment.SpecialFolder.ApplicationData)
	clr.AddReferenceToFileAndPath(IN[3])
	from RobotOM import *
	from System import Object
	
	surfaces = IN[0]
	fz = IN[1]
	load_name = IN[2]
	pts = IN[5]
	
	
	application = RobotApplicationClass()
	project = application.Project
	structure = project.Structure
	labels = structure.Labels
	loads = []


	####create Self Weight for beams to create wind as 2 after that
	#structure.Cases.Delete(1)
	caseG = structure.Cases.CreateSimple(1,"Self Weight", IRobotCaseNature.I_CN_PERMANENT, IRobotCaseAnalizeType.I_CAT_STATIC_LINEAR)
	sf = caseG.Records.New(IRobotLoadRecordType.I_LRT_DEAD)
	selfload = structure.Cases.Get(1).Records.Get(sf)
	selfload.SetValue(IRobotDeadRecordValues.I_DRV_COEFF, 1)
	selfload.SetValue(IRobotDeadRecordValues.I_DRV_ENTIRE_STRUCTURE, 1)
	selfload.SetValue(IRobotDeadRecordValues.I_DRV_Z, -1)
	
	###end self weight
		
	load_case = 2 #if no numbers befor exist - it will fail
	m = structure.Cases.Delete(load_case) #delete the case to avoid doubling
	#create case
	case_rob_type = IRobotCaseNature.I_CN_WIND
	case = structure.Cases.CreateSimple(load_case,load_name, case_rob_type, IRobotCaseAnalizeType.I_CAT_STATIC_LINEAR)
		
		
	loads =[]
	
	#create load

	for j in range(len(surfaces)):
		load_nmb = case.Records.New(IRobotLoadRecordType.I_LRT_IN_3_POINTS)
		load = structure.Cases.Get(load_case).Records.Get(load_nmb)
		load.SetPoint(1, pts[j][0].X, pts[j][0].Y, pts[j][0].Z)
		load.SetPoint(2, pts[j][1].X, pts[j][1].Y, pts[j][1].Z)
		load.SetPoint(3, pts[j][2].X, pts[j][2].Y, pts[j][2].Z)
		
		load.SetValue(IRobotIn3PointsRecordValues.I_3PRV_LOCAL_SYSTEM,1) #1 means True
		load.SetValue(IRobotIn3PointsRecordValues.I_3PRV_PZ1,fz[j][0]*1000)#in Pa
		load.SetValue(IRobotIn3PointsRecordValues.I_3PRV_PZ2,fz[j][1]*1000)
		load.SetValue(IRobotIn3PointsRecordValues.I_3PRV_PZ3,fz[j][2]*1000)	
		
		loads.append(load)
		#apply load
		load.Objects.FromText(surfaces[j].Number)





	OUT = "done"
else:	
	OUT = "switch Run is OFF"
# ----------------------------------------

# group: to start Robot
code_block_2 = CodeBlock { 0; }
byCoordinates = DynamoSimulation.RSA.AnalyticalModel.AnalyticalNode.ByCoordinates(x=code_block_2, y=code_block_2, z=code_block_2)

delete_point = Python(IN[0]=robot_library_address_change, IN[1]=apply_wind_load_3_point, IN[2]=byCoordinates)  # IronPython2
# ---------- delete_point.python (21 lines) ----------
import clr
clr.AddReference('ProtoGeometry')
from Autodesk.DesignScript.Geometry import *
	
from System import Environment
user = Environment.GetFolderPath(Environment.SpecialFolder.ApplicationData)
clr.AddReferenceToFileAndPath(IN[0])
from RobotOM import *
from System import Object

if 2<1:
#if IN[1] and IN[2]:
	application = RobotApplicationClass()
	project = application.Project
	structure = project.Structure
	
	structure.Nodes.Delete(1)
	OUT = 1
	
OUT = 1	
	
# ----------------------------------------
load_name_2 = CodeBlock { "CombDynamo"; }
create_combination = Python(IN[0]=robot_library_address_change, IN[1]=delete_point, IN[2]=load_name_2)  # IronPython2
# ---------- create_combination.python (27 lines) ----------
if IN[1]:

	import clr
	clr.AddReference('ProtoGeometry')
	from Autodesk.DesignScript.Geometry import *
	
	from System import Environment
	user = Environment.GetFolderPath(Environment.SpecialFolder.ApplicationData)
	clr.AddReferenceToFileAndPath(IN[0])
	from RobotOM import *
	from System import Object
	
	load_name = IN[2]
			
	application = RobotApplicationClass()
	project = application.Project
	structure = project.Structure
	cases = structure.cases
	
	comb = cases.CreateCombination(cases.FreeNumber, load_name, IRobotCombinationType.I_CBT_ULS, IRobotCaseNature.I_CN_WIND, IRobotCaseAnalizeType.I_CAT_COMB)
	#1.2G+Wu	
	comb.CaseFactors.New(1, 1.35) #actual weight by manufacturer!
	comb.CaseFactors.New(2, 1)
	

	OUT = "done"
else: OUT = "switch Run is OFF"
# ----------------------------------------
