# Dynamo graph Quadrosphere.Results v1.dyn (Dynamo 2.10.1.3976)

robot_library_address_change = StringInput("C:\Users\64210\AppData\Roaming\Dynamo\Dynamo Core\2.6\packages\Structural Analysis for Dynamo\bin\RSA\Interop.RobotOM.dll")  # "Robot library address, change version"
run = BoolSelector(true)
get_results = Python(IN[0]=robot_library_address_change, IN[1]=run)  # IronPython2; unwired: IN[2]
# ---------- get_results.python (60 lines) ----------
import clr
clr.AddReference('ProtoGeometry')
from Autodesk.DesignScript.Geometry import *
from System import Environment
user = Environment.GetFolderPath(Environment.SpecialFolder.ApplicationData)
clr.AddReferenceToFileAndPath(IN[0])#or r"C:\Users\64210\AppData\Roaming\Dynamo\Dynamo Core\2.6\packages\Structural Analysis for Dynamo\bin\RSA\Interop.RobotOM.dll"
from RobotOM import *
from System import Object
#from math import *
#from itertools import compress

#vars for robot
app = RobotApplicationClass()
#force_serv = IRobotBarForceServer
project = app.Project
structure = project.Structure
force_serv = structure.Results.Bars.Forces
#labels = structure.Labels
#loads = structure.Cases
#ProjectPrefs = project.Preferences
bar_col = structure.Bars.GetAll()
#objects = structure.Objects
#nodes = structure.Nodes
#cases = structure.Cases.GetAll()

_x0 = []
_y0 = []
_z0 = []

_x1 = []
_y1 = []
_z1 = []

if IN[1]:
	for i in range(1,bar_col.Count+1):
		bar = bar_col.Get(i)
		bar_num = bar.Number
		data0 = force_serv.Value(bar_num,3, 0) #last number is a section of a bar at a relative distance
		res_fy0 = data0.FY
		res_fx0 = data0.FX
		res_fz0 = data0.FZ
		
		_x0.append(res_fx0)
		_y0.append(res_fy0)
		_z0.append(res_fz0)
 
		data1 = force_serv.Value(bar_num,3, 1) #last number is a section of a bar at a relative distance
		res_fy1 = data1.FY
		res_fx1 = data1.FX
		res_fz1 = data1.FZ
		
		_x1.append(res_fx0)
		_y1.append(res_fy0)
		_z1.append(res_fz0) 
 
	OUT = _x0,_y0,_z0,_x1,_y1,_z1
	
	
	
else: OUT = "turn the switch ON"
# ----------------------------------------
bar_numbers = Python(IN[0]=robot_library_address_change, IN[1]=run)  # IronPython2
# ---------- bar_numbers.python (66 lines) ----------
import clr
clr.AddReference('ProtoGeometry')
from Autodesk.DesignScript.Geometry import *
from System import Environment
user = Environment.GetFolderPath(Environment.SpecialFolder.ApplicationData)
clr.AddReferenceToFileAndPath(IN[0])#or r"C:\Users\64210\AppData\Roaming\Dynamo\Dynamo Core\2.6\packages\Structural Analysis for Dynamo\bin\RSA\Interop.RobotOM.dll"
from RobotOM import *
from System import Object
#from math import *
#from itertools import compress

#vars for robot
app = RobotApplicationClass()
#force_serv = IRobotBarForceServer
project = app.Project
structure = project.Structure
force_serv = structure.Results.Bars.Forces
#labels = structure.Labels
#loads = structure.Cases
#ProjectPrefs = project.Preferences
bars = structure.Bars
bar_col = structure.Bars.GetAll()
#objects = structure.Objects
#nodes = structure.Nodes
#cases = structure.Cases.GetAll()


_x0 = []
_y0 = []
_z0 = []

_x1 = []
_y1 = []
_z1 = []

barz = []

if IN[1]:
	for i in range(1,bar_col.Count+1):
		bar = bar_col.Get(i)
		bar_num = bar.Number
		data0 = force_serv.Value(bar_num,3, 0) #last number is a section of a bar at a relative distance
		res_fy0 = data0.FY
		res_fx0 = data0.FX
		res_fz0 = data0.FZ
		
		_x0.append(bar_num)
		_x0.append(res_fx0)
		_y0.append(res_fy0)
		_z0.append(res_fz0)
 
		data1 = force_serv.Value(bar_num,3, 1) #last number is a section of a bar at a relative distance
		res_fy1 = data1.FY
		res_fx1 = data1.FX
		res_fz1 = data1.FZ
		
		_x1.append(res_fx0)
		_y1.append(res_fy0)
		_z1.append(res_fz0) 
		barz.append(bar_num)
 
	OUT = barz
	
	
	
else: OUT = "turn the switch ON"
# ----------------------------------------

# group: max Fx
get_the_max_fx = Python(IN[0]=get_results)  # IronPython2
# ---------- get_the_max_fx.python (10 lines) ----------
data = IN[0]

fxmax = max(max(data[0]),max(data[3]))
fxmin = min(min(data[0]),min(data[3]))

iXmax = data[0].index(fxmax),data[3].index(fxmax)
iXmin = data[0].index(fxmin),data[3].index(fxmin)


OUT = "Fx max, Fx min",[fxmax, fxmin],"element numbers, mind+1", [iXmax,iXmin]
# ----------------------------------------
all_forces_in_a_bar = Python(IN[0]=get_results, IN[1]=get_the_max_fx, IN[2]=bar_numbers)  # IronPython2
# ---------- all_forces_in_a_bar.python (24 lines) ----------
forces = IN[0]
d = IN[1]
indexes = d[3]
ff = list(set(indexes[0])),list(set(indexes[1]))
mm = ff[0][0],ff[1][0]
text = ["x0","y0","z0","x1","y1","z1"]
bar_n = IN[2]
t2 = ["Max tension force!", "Max compression force!"]


t = []
outp = []

for j in range(len(mm)):
	outp = []
	outp.append("Bar number in Robot: " + str(bar_n[mm[j]]))	
	outp.append(t2[j])
	for i in range(len(forces)):	
		force =round(forces[i][int(mm[j])]/10)*10/1000 	
		outp.append(text[i] +" : " +  str(force)+ " kN")
	t.append(outp)
	
	
OUT = t
# ----------------------------------------
watch = Watch(all_forces_in_a_bar)

# group: max Fz
get_the_max_fz = Python(IN[0]=get_results)  # IronPython2
# ---------- get_the_max_fz.python (11 lines) ----------
data = IN[0]

fxmax = max(max(data[2]),max(data[5]))
fxmin = min(min(data[2]),min(data[5]))


iXmax = data[2].index(fxmax),data[5].index(fxmax)
iXmin = data[2].index(fxmin),data[5].index(fxmin)


OUT = "Fz max, Fz min",[fxmax, fxmin],"element numbers, mind+1", [iXmax,iXmin]
# ----------------------------------------
all_forces_in_a_bar_2 = Python(IN[0]=get_results, IN[1]=get_the_max_fz, IN[2]=bar_numbers)  # IronPython2
# ---------- all_forces_in_a_bar_2.python (24 lines) ----------
forces = IN[0]
d = IN[1]
indexes = d[3]
ff = list(set(indexes[0])),list(set(indexes[1]))
mm = ff[0][0],ff[1][0]
text = ["x0","y0","z0","x1","y1","z1"]
bar_n = IN[2]
t2 = ["Max Z value force!", "Min Z value force!"]


t = []
outp = []

for j in range(len(mm)):
	outp = []
	outp.append("Bar number in Robot: " + str(bar_n[mm[j]]))	
	outp.append(t2[j])
	for i in range(len(forces)):	
		force =round(forces[i][int(mm[j])]/10)*10/1000 	
		outp.append(text[i] +" : " +  str(force)+ " kN")
	t.append(outp)
	
	
OUT = t
# ----------------------------------------
watch_2 = Watch(all_forces_in_a_bar_2)
