# Dynamo graph Quadrosphere_v4.dyn (Dynamo 2.10.1.3976)
# packages: Structural Analysis for Dynamo 2.11.0

string = StringInput("Structural Connections")
byName = Category.ByName(name=string)
all_elements_of_category = ElementsOfCategory(Category=byName)
filter_adaptive_only = Python(IN[0]=all_elements_of_category)  # IronPython2
# ---------- filter_adaptive_only.python (13 lines) ----------
#import sys
#import clr
#clr.AddReference('ProtoGeometry')
#from Autodesk.DesignScript.Geometry import *

p = IN[0]
m = []

for i in p:
	if str(i.GetType()) == "Revit.Elements.AdaptiveComponent":
		m.append(i)

OUT = m
# ----------------------------------------
code_block = CodeBlock { "beam"; }
filter = Python(IN[0]=filter_adaptive_only, IN[1]=code_block)  # IronPython2
# ---------- filter.python (8 lines) ----------
ss = IN[0]
gg = []
for i in ss:
	 if IN[1] in str(i):
	 	gg.append(i)

	 	
OUT = gg
# ----------------------------------------
locations = AdaptiveComponent.Locations(adaptiveComponent=filter)
watch = Watch(locations)
to_meters_rearrange_filter = Python(IN[0]=watch)  # IronPython2
# ---------- to_meters_rearrange_filter.python (52 lines) ----------
import clr
clr.AddReference('ProtoGeometry')
from Autodesk.DesignScript.Geometry import *



p = IN[0]
outp = []

p1 = []
p2 = []
p3 = []

if isinstance(p[0], list):
	cp = "list of elements"
	for i in p:
		gg = []
		for j in i:

			xxx = j.X
			yyy = j.Y
			zzz = j.Z			
			
			if -0.001<j.X<0.001: #in meters!
				xxx = 0
			if -0.001<j.Y<0.001:
				yyy = 0	
			if -0.001<j.Z<0.001:
				zzz = 0					

				
			gg.append(Point.ByCoordinates(xxx/1000,yyy/1000,zzz/1000))
			
		outp.append(gg)
		
	for i in range(len(p)):
		p1.append(outp[i][0])
		p2.append(outp[i][1])
		p3.append(outp[i][2])		
		
	
		
else: 
	cp = "one element"
	for j in p:
		outp.append(Point.ByCoordinates(j.X/1000,j.Y/1000,j.Z/1000))		
	
	p1.append(outp[0])
	p2.append(outp[1])
	p3.append(outp[2])	
	
OUT = p1,p2,p3
# ----------------------------------------
code_block_2 = CodeBlock(p1=to_meters_rearrange_filter) { p1[0]; }
code_block_3 = CodeBlock(p2=to_meters_rearrange_filter) { p2[1]; }
code_block_4 = CodeBlock(p3=to_meters_rearrange_filter) { p3[2]; }
fix_fckn_center = Python(IN[0]=code_block_2, IN[1]=code_block_3, IN[2]=code_block_4)  # IronPython2
# ---------- fix_fckn_center.python (25 lines) ----------
import clr
clr.AddReference('ProtoGeometry')
from Autodesk.DesignScript.Geometry import *


p1 = IN[0]
p2 = IN[1]
p3 = IN[2]

error = list(set(p3))

xx = error[0].X
yy = error[0].Y

p1f = []
p2f = []


if len(error)==1:
	for i in range(len(p1)):
		p1f.append(Point.ByCoordinates(p1[i].X-xx,p1[i].Y-yy,p1[i].Z))
		p2f.append(Point.ByCoordinates(p2[i].X-xx,p2[i].Y-yy,p2[i].Z))


OUT = p1f,p2f
# ----------------------------------------
firstItem = List.FirstItem(list=fix_fckn_center)
lastItem = List.LastItem(list=fix_fckn_center)
byStartPointEndPoint = Line.ByStartPointEndPoint(startPoint=firstItem, endPoint=lastItem)
byLine = DynamoSimulation.RSA.AnalyticalModel.AnalyticalBar.ByLine(line=byStartPointEndPoint)
rearrange_by_n = Python(IN[0]=watch)  # IronPython2
# ---------- rearrange_by_n.python (40 lines) ----------
import clr
clr.AddReference('ProtoGeometry')
from Autodesk.DesignScript.Geometry import *



p = IN[0]
outp = []

p1 = []
p2 = []
p3 = []

scale = 1

if isinstance(p[0], list):
	cp = "list of elements"
	for i in p:
		gg = []
		for j in i:
			gg.append(Point.ByCoordinates(j.X/scale,j.Y/scale,j.Z/scale))
		outp.append(gg)
		
	for i in range(len(p)):
		p1.append(outp[i][0])
		p2.append(outp[i][1])
		p3.append(outp[i][2])		
		
	
		
else: 
	cp = "one element"
	for j in p:
		outp.append(Point.ByCoordinates(j.X/scale,j.Y/scale,j.Z/scale))		
	
	p1.append(outp[0])
	p2.append(outp[1])
	p3.append(outp[2])	
	
OUT = p1,p2,p3
# ----------------------------------------
code_block_5 = CodeBlock(p1=rearrange_by_n) { p1[0]; }
code_block_6 = CodeBlock(p2=rearrange_by_n) { p2[1]; }
code_block_7 = CodeBlock(p3=rearrange_by_n) { p3[2]; }
angle = Python(IN[0]=code_block_5, IN[1]=code_block_6, IN[2]=code_block_7)  # IronPython2
# ---------- angle.python (144 lines) ----------
#this script is to calculate the angle to rotate the section
#unfortunately it is impossible to get it from adaptive family because adaptive points set to GLOBAL behave unpredictable

import clr
clr.AddReference('ProtoGeometry')
from Autodesk.DesignScript.Geometry import *
import math

# an -  variable for angle
# x_1_3 means x distance between points 1 and 3
# L_1_3 means shortest distance between points 1 and 3

p1_nt = IN[0]
p1 = []
p2_nt = IN[1]
p2 = []
p3= IN[2]

an_fi_d = [] #calculated angle


test = []
test2 = []

if 2>1:
	
	x_1_2 = []
	x_1_3 = []
	x_2_3 = []
	
	y_1_2 = [] 
	y_1_3 = []
	y_2_3 = []
	
	z_1_2 = []
	z_1_3 = []
	z_2_3 = []
	
	dim12 = []
	dim13 = []
	dim23 = []
	
	L_1_2 = []
	L_1_3 = []
	L_2_3 = []

	an1 = []
	an1_d = []
	
	A1 = []
	
	an_g = []
	an_g_d = []
	
	coeff = []
	
	A1_x = []
	A1_y = []
	
	x_A1_3 = []
	y_A1_3 = []
	
	A = []

	B = []
	L1H = []
	yy = []
	xx = []
	f = []
	
	an_fi = []
	fortriang = []

	for i in range (len(p3)): #p3 is always down
		if p2_nt[i].Z>p1_nt[i].Z:
			test.append("p2.Z-p1.Z>0 ok")
			p1.append(p1_nt[i])
			p2.append(p2_nt[i])
		else:
			test.append("p2.Z-p1.Z<0 inverted")
			p1.append(p2_nt[i])		
			p2.append(p1_nt[i])
			
		x_1_2.append(math.fabs(p2[i].X-p1[i].X))
		x_1_3.append(math.fabs(p3[i].X-p1[i].X))
		x_2_3.append(math.fabs(p3[i].X-p2[i].X))

		y_1_2.append(math.fabs(p2[i].Y-p1[i].Y))
		y_1_3.append(math.fabs(p3[i].Y-p1[i].Y))
		y_2_3.append(math.fabs(p3[i].Y-p2[i].Y))

		z_1_2.append(math.fabs(p2[i].Z-p1[i].Z))
		z_1_3.append(math.fabs(p3[i].Z-p1[i].Z))
		z_2_3.append(math.fabs(p3[i].Z-p2[i].Z))

		dim12.append((x_1_2[i] ** 2 + y_1_2[i] ** 2) ** 0.5)
		dim13.append((x_1_3[i] ** 2 + y_1_3[i] ** 2) ** 0.5)
		dim23.append((x_2_3[i] ** 2 + y_2_3[i] ** 2) ** 0.5)
	
		L_1_2.append((z_1_2[i] ** 2 + dim12[i] ** 2) ** 0.5)
		L_1_3.append((z_1_3[i] ** 2 + dim13[i] ** 2) ** 0.5)
		L_2_3.append((z_2_3[i] ** 2 + dim23[i] ** 2) ** 0.5)
	

		an1.append(math.acos((L_1_2[i] ** 2  + L_1_3[i] ** 2  - L_2_3[i] ** 2 ) / (2 * L_1_2[i] * L_1_3[i])))
		an1_d.append( an1[i]*180/math.pi)
		
		A1.append(L_1_3[i] * math.cos(an1[i])) #length from p1 to point perpendicular point 3 (i.e. p3 projected on L_1_2)
	
		an_g.append(math.acos((L_1_2[i] ** 2  + dim12[i] ** 2  - z_1_2[i] ** 2 ) / (2 * L_1_2[i] * dim12[i])))
		an_g_d.append(an_g[i]*180/math.pi)
		
		coeff.append(A1[i]/L_1_2[i])
		
		#now calulate all six edges of the prism
		if(p2[i].X >= p1[i].X):
			A1_x.append(p1[i].X + x_1_2[i]*(coeff[i]))  # x coord of p A1
		else:
			A1_x.append(p1[i].X - x_1_2[i]*(coeff[i]))
		if(p2[i].Y >= p1[i].Y):		
			A1_y.append(p1[i].Y + y_1_2[i]*(coeff[i]))# y coord of p A1
		else:
			A1_y.append(p1[i].Y - y_1_2[i]*(coeff[i]))
			
		x_A1_3.append(math.fabs(A1_x[i]-p3[i].X))
		y_A1_3.append(math.fabs(A1_y[i]-p3[i].Y))
		A.append((x_A1_3[i] ** 2 + y_A1_3[i] ** 2) ** 0.5)  #horizontal edge from A1 to point 3 	
		
		B.append(math.fabs(p1[i].Z+z_1_2[i]*coeff[i] - p3[i].Z))  #vertical edge
		L1H.append((L_1_3[i] ** 2 - A1[i] ** 2) ** 0.5) #from A1 point to point 3
		yy.append(B[i]*math.cos(an_g[i])) #opposite to B
		xx.append(B[i]*math.sin(an_g[i])) #horizontal
		f.append((A[i] ** 2 - xx[i] ** 2) ** 0.5)   #horizontal opposite to A
		fortriang.append((L1H[i]**2+yy[i]**2-f[i]**2)/(2*L1H[i]*yy[i]))
		
		if fortriang[i] <= 1: #catch impossible geometry
			an_fi.append(math.acos((L1H[i]**2+yy[i]**2-f[i]**2)/(2*L1H[i]*yy[i])))			
		else: 
			an_fi.append(0)	
		
		an_fi_d.append(an_fi[i]*180/math.pi)

		#full OUT = x_1_2,x_1_3,x_2_3,y_1_2,y_1_3,y_2_3,z_1_2,z_1_3,z_2_3,dim12,dim13,dim23,L_1_2,L_1_3,L_2_3,an1,an1_d,A1,an_g,an_g_d,coeff,A1_x,A1_y,x_A1_3,y_A1_3,A,B,L1H,yy,xx,f,an_fi, an_fi_d
		OUT = an_fi_d
# ----------------------------------------
angle_2 = Watch(angle)

# group: Steps: 1. Run 2. Change number 3. Run 4. Change number 5. Run DONE
number_slider = DoubleSlider(8, range=0..10 step 1)

matrix_angle_reset = Python(IN[0]=firstItem, IN[1]=lastItem, IN[2]=number_slider)  # IronPython2
# ---------- matrix_angle_reset.python (175 lines) ----------
import clr
clr.AddReference('ProtoGeometry')
from Autodesk.DesignScript.Geometry import *

from System import Environment
user = Environment.GetFolderPath(Environment.SpecialFolder.ApplicationData)
clr.AddReferenceToFileAndPath(user +r"\Dynamo\Dynamo Core\2.6\packages\Structural Analysis for Dynamo\bin\RSA\Interop.RobotOM.dll")
from RobotOM import *
from System import Object


pt1 = IN[0]
pt2 = IN[1]
sw = IN[2]

if sw!=None or sw!="null":
	sw = 1
else: sw = 0



coord = []
xx = []
yy = []
zz = []


application = RobotApplicationClass()
project = application.Project
structure = project.Structure
#labels = structure.Labels
#ProjectPrefs = project.Preferences
bars = structure.Bars
bar_col = bars.GetAll()



kk = []
zz = []
ff = []
m = 0
ht = []

#get the bars number
try:
	for i in range(1,1000):
		if bar_col.Get(i):
			m = m+1 #total bars
except: mmmm = "tt"

#get all the bars
for i in range(1,m):
	kk.append(bar_col.Get(i))
	
#reset the angle!	
for i in kk:
	ht.append(i.Gamma) #log what was before reset
	i.Gamma = 0
	zz.append(i.Gamma)



RCF = application.CmpntFactory 
GP3D = IRobotComponentType.I_CT_GEO_POINT_3D
_x = RCF.Create(GP3D) # X local axis vector in global coordinates
_y = RCF.Create(GP3D) #Y local axis 
_z = RCF.Create(GP3D) #Z local axis

### test example
#br = bar_col.Get(1)
#brn = br.GetLCS(_x,_y,_z)
#ccc = [_x.X, _x.Y,_x.Z],[_y.X, _y.Y,_y.Z],[_z.X, _z.Y,_z.Z]
###
kk = []
zz = []
ff = []
#try:  can do simpler
#	for i in range(1,1000):
#		kk.append(bar_col.Get(i))
#		mm = i
#except:
#	kk = "err"
if sw ==1:
	for i in range(1,len(pt1)+1):
		zz.append(bar_col.Get(i))
	
	for i in zz:
		f = (i.GetLCS(_x,_y,_z))
		g =[_x.X, _x.Y,_x.Z],[_y.X, _y.Y,_y.Z],[_z.X, _z.Y,_z.Z]
		ff.append(g)
	
	### GO!
	go = []
	angles = []
	for i in range(len(pt1)):	
#######	
		_yY = ff[i][1][1]	
		if -0.0000001<_yY < 0.000000001:
			_yY = 0
		if _yY > 0.99999999:
			_yY = 1
		if _yY < -0.99999999:
			_yY = -1
				
		_yX = ff[i][1][0]	
		if -0.0000001<_yX<0.0000001:
			yX = 0
		if _yX>0.99999999:
			_yX = 1
		if _yX < -0.99999999:
			_yX = -1
#########

		pt1X = pt1[i].X
		pt1Y = pt1[i].Y
		pt2X = pt2[i].X
		pt2Y = pt2[i].Y		


		if -0.000001<pt1[i].X<0.000001:
 			pt1X = 0

		if -0.000001<pt1[i].Y<0.000001:
 			pt1Y = 0

		
		if -0.000001<pt2[i].X<0.000001:
 			pt2X = 0

		if -0.000001<pt2[i].Y<0.000001:
 			pt2Y = 0
#########


		if _yY==0 or abs(_yY)==1:
			if abs(pt1Y+_yY) > abs(pt1Y):
				angles.append(-1)
			elif abs(pt1X+_yX) > abs(pt1X):
				#angles.append([pt1[i].X, pt1[i].Y, pt2[i].X,pt2[i].Y, _yX, _yY])				
				angles.append(-1)
			else: 
				angles.append(1)
	
		else:		
			if pt1X != 0 and abs(pt1Y)<abs(pt2Y): 		 	
				if abs(pt1X+_yX) > abs(pt1X):
					angles.append(-1)
					#angles.append([pt1[i].X, pt1[i].Y, pt2[i].X,pt2[i].Y, _yX, _yY])	
				else: 
					angles.append(1)
					#angles.append([pt1X, pt1Y, pt2X,pt2Y, _yX, _yY])
			elif pt2X != 0 and abs(pt2Y)<abs(pt1Y): 
				if abs(pt2X+_yX) > abs(pt2X):
					angles.append(-1)					
				else: angles.append(1)
##################################
			elif pt1X != 0 and abs(pt1Y)>abs(pt2Y): 		 	
				if abs(pt1X+_yX) < abs(pt1X):
					angles.append(-1)
					#angles.append([pt1[i].X, pt1[i].Y, pt2[i].X,pt2[i].Y, _yX, _yY])	
				else: 
					angles.append(1)
					#angles.append([pt1X, pt1Y, pt2X,pt2Y, _yX, _yY])
			elif pt2X != 0 and abs(pt2Y)>abs(pt1Y): 
				if abs(pt2X+_yX) < abs(pt2X):
					angles.append(-1)					
				else: angles.append(1)
###############################

			else: 
					angles.append(0)	



OUT = angles
# ----------------------------------------
watch_2 = Watch(matrix_angle_reset)
mul = Python(IN[0]=angle_2, IN[1]=watch_2)  # IronPython2
# ---------- mul.python (13 lines) ----------
n = IN[0]
m = IN[1]


nn = []

if m != None or m!= "null":
	for i in range(len(n)):
		nn.append(n[i]*m[i])
		OUT = nn
		
else: OUT = n
	
# ----------------------------------------

# group: Long lacing
setGammaAngle = DynamoSimulation.RSA.AnalyticalModel.AnalyticalBar.SetGammaAngle(bars=byLine, number=mul, lacing=Longest)

combine_new = Python(IN[0]=fix_fckn_center, IN[1]=code_block_4)  # IronPython2
# ---------- combine_new.python (11 lines) ----------
xy = IN[0]
z = IN[1]

gg = []

for i in range(len(z)):
	gg.append(xy[0][i])
	gg.append(xy[1][i])
	gg.append(z[i])

OUT = gg
# ----------------------------------------

# group: supports
for_z_0 = Python(IN[0]=combine_new)  # IronPython2
# ---------- for_z_0.python (22 lines) ----------
import clr
clr.AddReference('ProtoGeometry')
from Autodesk.DesignScript.Geometry import *


p = IN[0]
outp = []
z_coord = []


if isinstance(p, list):
	cp = "list of elements"
	for i in p:
		if i.Z==0: #lazy way
			outp.append(i)
		z_coord.append(i.Z)	
else: 
	cp = "one element"



OUT = set(outp)	
# ----------------------------------------
byPoint = DynamoSimulation.RSA.AnalyticalModel.AnalyticalNode.ByPoint(point=for_z_0)
code_block_8 = CodeBlock { "Pinned"; }
setSupportByName = DynamoSimulation.RSA.AnalyticalModel.AnalyticalNode.SetSupportByName(nodes=byPoint, name=code_block_8)

# group: set section
code_block_9 = CodeBlock { ["alpbau"]; }
code_block_10 = CodeBlock { ["WOOD"]; }
code_block_11 = CodeBlock { "Section width"; }
getParameterValueByName = Element.GetParameterValueByName(element=filter, parameterName=code_block_11)
code_block_12 = CodeBlock { "Section height"; }
getParameterValueByName_2 = Element.GetParameterValueByName(element=filter, parameterName=code_block_12)

width = CodeBlock(x=getParameterValueByName) { [x[0]/1000]; }
height = CodeBlock(x=getParameterValueByName_2) { [x[0]/1000]; }

# group (continued): set section
create_bar_section = Python(IN[0]=code_block_9, IN[1]=code_block_10, IN[2]=width, IN[3]=height, IN[4]=number_slider)  # IronPython2
# ---------- create_bar_section.python (48 lines) ----------
import clr
clr.AddReference('ProtoGeometry')
from Autodesk.DesignScript.Geometry import *

from System import Environment
user = Environment.GetFolderPath(Environment.SpecialFolder.ApplicationData)
clr.AddReferenceToFileAndPath(user +r"\Dynamo\Dynamo Core\2.6\packages\Structural Analysis for Dynamo\bin\RSA\Interop.RobotOM.dll")
from RobotOM import *
from System import Object
#The inputs to this node will be stored as a list in the IN variables.
#Define input

USec_name = IN[0]
USec_mat = IN[1]
USec_B = IN[2]
USec_H = IN[3]
reload = IN[4]

application = RobotApplicationClass()
project = application.Project
structure = project.Structure
labels = structure.Labels
ProjectPrefs = project.Preferences
bars = structure.Bars




#User rectangular section
for i in range(len(USec_name)):
	lab_serv = IRobotLabelServer 
	lab_serv = labels
	sec = IRobotLabel
	sec = lab_serv.create(IRobotLabelType.I_LT_BAR_SECTION, USec_name[i])
	data = sec.data
	data.Type = IRobotBarSectionType.I_BST_NS_RECT
	data.ShapeType = IRobotBarSectionShapeType.I_BSST_RECT_FILLED
	nonst_data = IRobotBarSectionNonstdData
	nonst_data = data.CreateNonstd(0)
	nonst_data.SetValue(IRobotBarSectionNonstdDataValue.I_BSNDV_RECT_B,USec_B[i])
	nonst_data.SetValue(IRobotBarSectionNonstdDataValue.I_BSNDV_RECT_H,USec_H[i])
	data.MaterialName = USec_mat[i]
	data.CalcNonstdGeometry()
	lab_serv.Store(sec)
	


OUT = "labels gemaakt"
# ----------------------------------------

wait_for = Python(IN[0]=code_block_9, IN[1]=create_bar_section)  # IronPython2
# ---------- wait_for.python (5 lines) ----------
name = IN[0]
bypass = IN[1]

if bypass!= None or bypass!= "null":
	OUT = name[0]
# ----------------------------------------

# group (continued): set section
setSectionByName = DynamoSimulation.RSA.AnalyticalModel.AnalyticalBar.SetSectionByName(analyticalBars=byLine, name=wait_for)

check = Python(IN[0]=code_block_4)  # IronPython2
# ---------- check.python (6 lines) ----------
p1 = IN[0]

if len(list(set(p1)))!=1:
	error

else: OUT = set(p1)
# ----------------------------------------
matrix_angle_check = Python(IN[0]=firstItem, IN[1]=lastItem, IN[2]=number_slider)  # IronPython2
# ---------- matrix_angle_check.python (154 lines) ----------
import clr
clr.AddReference('ProtoGeometry')
from Autodesk.DesignScript.Geometry import *

from System import Environment
user = Environment.GetFolderPath(Environment.SpecialFolder.ApplicationData)
clr.AddReferenceToFileAndPath(user +r"\Dynamo\Dynamo Core\2.6\packages\Structural Analysis for Dynamo\bin\RSA\Interop.RobotOM.dll")
from RobotOM import *
from System import Object

import math



pt1 = IN[0]
pt2 = IN[1]

sw = IN[2]

if sw!=None or sw!="null":
	sw = 1
else: sw = 0



coord = []
xx = []
yy = []
zz = []


application = RobotApplicationClass()
project = application.Project
structure = project.Structure
#labels = structure.Labels
#ProjectPrefs = project.Preferences
bars = structure.Bars
bar_col = bars.GetAll()
bars_total = bars.FreeNumber


RCF = application.CmpntFactory 
GP3D = IRobotComponentType.I_CT_GEO_POINT_3D
_x = RCF.Create(GP3D) # X local axis vector in global coordinates
_y = RCF.Create(GP3D) #Y local axis 
_z = RCF.Create(GP3D) #Z local axis

### test example
#br = bar_col.Get(1)
#brn = br.GetLCS(_x,_y,_z)
#ccc = [_x.X, _x.Y,_x.Z],[_y.X, _y.Y,_y.Z],[_z.X, _z.Y,_z.Z]
###
kk = []
zz = []
ff = []
#try:  can do simpler
#	for i in range(1,1000):
#		kk.append(bar_col.Get(i))
#		mm = i
#except:
#	kk = "err"
if sw ==1:
	for i in range(1,len(pt1)+1):
		zz.append(bar_col.Get(i))
	
	for i in zz:
		f = (i.GetLCS(_x,_y,_z))
		g =[_x.X, _x.Y,_x.Z],[_y.X, _y.Y,_y.Z],[_z.X, _z.Y,_z.Z]
		ff.append(g)
	
	### GO!
	go = []
	angles = []
	for i in range(len(pt1)):
		
		_yY = ff[i][1][1]	
		if -0.000001<_yY < 0.000001:
			_yY = 0
		if _yY > 0.9999999:
			_yY = 1
		if _yY < -0.9999999:
			_yY = -1
				
		_yX = ff[i][1][0]	
		if -0.000001<_yX<0.000001:
 			yX = 0
		if _yX>0.9999999:
			_yX = 1
		if _yX < -0.9999999:
			_yX = -1
			
			
		pt1X = pt1[i].X
		pt1Y = pt1[i].Y
		pt2X = pt2[i].X
		pt2Y = pt2[i].Y		


		if -0.000001<pt1[i].X<0.000001:
 			pt1X = 0

		if -0.000001<pt1[i].Y<0.000001:
 			pt1Y = 0

		
		if -0.000001<pt2[i].X<0.000001:
 			pt2X = 0

		if -0.000001<pt2[i].Y<0.000001:
 			pt2Y = 0

			
		
		if _yY==0 or abs(_yY)==1:
			if abs(pt1Y+_yY) > abs(pt1Y):
				angles.append("ortho 1 TO ROTATE")
			elif abs(pt1X+_yX) > abs(pt1X):
				#angles.append([pt1[i].X, pt1[i].Y, pt2[i].X,pt2[i].Y, _yX, _yY])				
				angles.append("ortho 2 TO ROTATE")
			else: 
				angles.append("ortho")
	
		else:		
			if pt1X != 0 and abs(pt1Y)<abs(pt2Y): 		 	
				if abs(pt1X+_yX) > abs(pt1X):
					angles.append("non ortho Diamond1 TO ROTATE")
					#angles.append([pt1[i].X, pt1[i].Y, pt2[i].X,pt2[i].Y, _yX, _yY])	
				else: 
					angles.append("non ortho Diamond1")
					#angles.append([pt1X, pt1Y, pt2X,pt2Y, _yX, _yY])
			elif pt2X != 0 and abs(pt2Y)<abs(pt1Y): 
				if abs(pt2X+_yX) > abs(pt2X):
					angles.append("non ortho Diamond2 TO ROTATE")					
				else: angles.append("non ortho Diamond2")
##################################
			elif pt1X != 0 and abs(pt1Y)>abs(pt2Y): 		 	
				if abs(pt1X+_yX) < abs(pt1X):
					angles.append("non ortho Shevron1 TO ROTATE")
					#angles.append([pt1[i].X, pt1[i].Y, pt2[i].X,pt2[i].Y, _yX, _yY])	
				else: 
					angles.append("non ortho Shevron1")
					#angles.append([pt1X, pt1Y, pt2X,pt2Y, _yX, _yY])
			elif pt2X != 0 and abs(pt2Y)>abs(pt1Y): 
				if abs(pt2X+_yX) < abs(pt2X):
					angles.append("non ortho Shevron2 TO ROTATE")					
				else: angles.append("non ortho Shevron2")
###############################



			else: 
					angles.append([pt1X, pt1Y, pt2X,pt2Y, _yX, _yY])

OUT = angles
# ----------------------------------------
watch_3 = Watch(matrix_angle_check)
select_model_elements = DSModelElementsSelection()  # 156 picked in the model
