# Dynamo custom node Color_calc_Red_Green.dyf (Dynamo 2.6.0.8481)
# category: Core

test = Input(test: var[]..[])
file_path = Filename(".\green.jpg")
file_path_2 = Filename(".\red.jpg")
if_ = If(test=test, true=file_path, false=file_path_2)
file_from_path = FileObject(path=if_)
readFromFile = Image.ReadFromFile(file=file_from_path)
image = Output(readFromFile)
