# Dynamo custom node File_opener.dyf (Dynamo 2.10.1.3976)
# category: Core
# Open selected file in preselected in the node software

FilePath = Input(FilePath: var[]..[])
Run = Input(Run: bool = False)
software_path = StringInput("C:\Windows\System32\notepad.exe")
string = StringInput("C:\Program Files (x86)\Adobe\Acrobat DC\Acrobat\Acrobat.exe")
string_2 = StringInput("C:\Program Files\Microsoft Office 15\root\office15\EXCEL.EXE")
programs_to_open = Python(IN[0]=FilePath, IN[1]=software_path, IN[2]=string, IN[3]=string_2)  # IronPython2
# ---------- programs_to_open.python (19 lines) ----------
name = IN[0]

x = name.find('.txt',1)
SPath=[]
if x>0: SPath = str(IN[1])

x = name.find('.pdf',1)
SPath=[]
if x>0: SPath = str(IN[2])

x = name.find('.xlsx',1)
SPath=[]
if x>0: SPath = str(IN[3])





OUT = SPath
# ----------------------------------------
file_open = Python(IN[0]=FilePath, IN[1]=Run, IN[2]=programs_to_open)  # IronPython2
# ---------- file_open.python (28 lines) ----------
# Load the Python Standard and DesignScript Libraries
import sys
import clr
import os
import subprocess
#clr.AddReference('ProtoGeometry')
#from Autodesk.DesignScript.Geometry import *

# The inputs to this node will be stored as a list in the IN variables.
#dataEnteringNode = IN

# Place your code below this line


txt1 = IN[0]
#txt1 = 'C:\1.txt'
bool = IN[1]


#SPath = r'C:\Windows\System32\notepad.exe'
SPath = str(IN[2])

if bool:
	subprocess.Popen([SPath, txt1])

#subprocess.Popen('explorer "C:\temp"') #itWorks!
# Assign your output to the OUT variable.
#OUT = 0
# ----------------------------------------
