# Dynamo graph Home.dyn (Dynamo 2.6.0.8481)

# group: INPUT
directory_path = Directory("C:\timin docs")
boolean = BoolSelector(false)
folder_open = Python(IN[0]=directory_path, IN[1]=boolean)
# ---------- folder_open.python (23 lines) ----------
# Load the Python Standard and DesignScript Libraries
import sys
import clr
import os
import subprocess
#clr.AddReference('ProtoGeometry')
#from Autodesk.DesignScript.Geometry import *

# The inputs to this node will be stored as a list in the IN variables.
#dataEnteringNode = IN

# Place your code below this line


txt1 = str('explorer '+'"'+str(IN[0])+'"')
bool = IN[1]

if bool:
	#subprocess.Popen('explorer "C:\temp"') 
	subprocess.Popen(txt1)
	#, shell=True) 
# Assign your output to the OUT variable.
OUT = txt1
# ----------------------------------------
ductility_to_u_1 = CodeBlock()
# ---------- ductility_to_u_1.designscript (4 lines) ----------
def u1()
{
return=0.9/0.728;
};
# ----------------------------------------

# group: Open
file_path = Filename("..\..\..\timin docs\calculation_templ\Actions.Loads - Copy.xlsx")
boolean_2 = BoolSelector(false)
file_opener = Custom[File_opener](FilePath=file_path, Run=boolean_2)  # Open selected file in preselected in the node software

forces_kn_m = CodeBlock { V=10; M=20; }
code_block = CodeBlock { u1(); }
to_u_1 = forces_kn_m.V * code_block
code_block_2 = CodeBlock { 0; }
watch = Watch(code_block_2)
code_block_3 = CodeBlock { 1; }
gt = watch > code_block_3
color_calc_Red_Green = Custom[Color_calc_Red_Green](test=gt)
watch_image = WatchImageCore(image=color_calc_Red_Green)
